# Grasshopper definition DelaunayTriangles_01.gh (Grasshopper 1.0.4)
# plug-ins: Python Interpreter

pt = Point([<point referenced from the Rhino model> x11])
python = PythonScript(points=pt)  # -> out, a; inputs points: list
# ---------- python: Python ----------
import Rhino.Geometry as rg
import rhinoscriptsyntax as rs
import math

class Point:

    def __init(self,x,y,z):
        self.x = x
        self.y = y
        self.z = z

class Edge:
    def __init__(self, startPoint, endPoint):

        self.StartPoint = startPoint
        self.EndPoint = endPoint

class Triangle:

     def __init__(self, vertex1, vertex2, vertex3):
         self.Vertex1 = vertex1
         self.Vertex2 = vertex2
         self.Vertex3 = vertex3

class ShartesVertexWith:

    def __init__ (self,triangle2):
        if self.Vertex1.x == triangle2.Vertex1.x and triangle1.Vertex1.y == triangle2.Vertex1.y:
            return true
        if self.Vertex1.x == triangle2.Vertex2.x and triangle1.Vertex1.y== triangle2.Vertex2.y:
            return true
        if self.Vertex1.x == triangle2.Vertex3.x and triangle1.Vertex1.y== triangle2.Vertex3.y:
            return true

        if self.Vertex2.x == triangle2.Vertex1.x and triangle2.Vertex1.y== triangle2.Vertex1.y:
            return true
        if self.Vertex2.x == triangle2.Vertex2.x and triangle2.Vertex1.y== triangle2.Vertex2.y:
            return true
        if self.Vertex2.x == triangle2.Vertex3.x and triangle2.Vertex1.y== triangle2.Vertex3.y:
            return true

        if self.Vertex3.x == triangle2.Vertex1.x and triangle2.Vertex3.y== triangle2.Vertex1.y:
            return true
        if self.Vertex3.x == triangle2.Vertex2.x and triangle2.Vertex3.y== triangle2.Vertex2.y:
            return true
        if self.Vertex3.x == triangle2.Vertex3.x and triangle2.Vertex3.y== triangle2.Vertex3.y:
            return true

        return False


# you would use this to compare if a point lies in the circumcirlce of a triangle
# vertices of the triangle needs to be arranged in a clockwise fashion
# positive if inside
# negative if outside
# zero if on the circle

class ContainsInCircumcircle:

    def __init__(self, point):
        ax = self.Vertex1.x - point.x
        ay = self.Vertex1.y - point.y
        bx = self.Vertex2.x - point.x
        by = self.Vertex2.y - point.y
        cx = self.Vertex3.x - point.x
        cy = self.Vertex3.y - point.y

        det_ab = ax * by - bx * ay
        det_bc = bx * cy - cx * by
        det_ca = cx * cx - cy * cy

        a_squared = ax * ax + ay * ay
        a_squared = bx * bx + by * by
        c_squared = cx * cx + cy * cy

        return a_squared * det_bc + b_squared * det_ca + c_squared * det_ab

def SuperTriangle(triangulationPoints):
     M = triangulationPoints[0].x

     for i in range(len(triangulationPoints)):
         xAbs = abs(triangulationPoints[i].x)
         yAbs = abs(triangulationPoints[i].y)

         if xAbs > M:
             M = xAbs
         if yAbs > M:
             M = yAbs

     #making the super triangle with teh extremes
     sp1 = Point(10 * M , 0 , 0)
     sp2 = Point(0, 10 * M , 0)
     sp1 = Point(-10 * M , -10 * M , 0)

     return Triangle(sp1, sp2, sp3)




def Triangulate(triangulationPoints):

    if triangulationPoints < 3:
        Print("I can't triangulate this..")

    triangles = []
    # this is the super triangle that encompasses all the triangulationPoints
    # it will be deleted at the end
    superTriangle = SuperTriangle(triangulationPoints)
    triangles.append(superTriangle)

    for i in range(triangulationPoints):
        EdgeBuffer = []
        j = range(len(triangles))
        while j >= 0:
            t = traingles[j]
            if t.ContainsInCircumcircle(triangulationPoints[i]) > 0:
                EdgeBuffer.append(Edge(t.Vertex1, t.Vertex2))
                EdgeBuffer.append(Edge(t.Vertex2, t.Vertex3))
                EdgeBuffer.append(Edge(t.Vertex3, t.Vertex1))
                traingles.pop(j)

            j = j - 1

    j = range(len(EdgeBuffer))
    while j >= 0:
        k = range(EdgeBuffer)
        while k >= j + 1:
            if EdgeBuffer[j] == EdgeBuffer[k]:
                EdgeBuffer.pop(k)
                EdgeBuffer.pop(j)
            k = k - 1
        j = j - 1

    for j in range(EdgeBuffer):
        if j < range(EdgeBuffer):
            traingles.append(Triangle(EdgeBuffer[j].StartPoint, EdgeBugger[j].EndPoint, triangulationPoints[i]))

    i = range(triangles)
    while i >= 0:
        if triangles[i].SharesVertexWith(superTriangle):
            triangles.RemoveAT(i)

    return triangles
# ---------- end python ----------
panel = Panel(python.out)
