# Grasshopper definition PointClass_1.gh (Grasshopper 1.0.4)
# plug-ins: Python Interpreter

path = FilePath("/Users/karimdaw/Dropbox/02_TU_DELFT/Geo1004_TuDelft/Assignment2/topVoxels.csv")
python = PythonScript(path=path)  # -> out, contents
# ---------- python: Python ----------
__author__ = "karimdaw"

import rhinoscriptsyntax as rs

with open(path , 'r') as fp:
	contents = fp.readlines()
# ---------- end python ----------
pointcloud = Point(python.contents)
pt = Point([Point(4.137007957, 6.024837666, 3), Point(3, 3, 1), Point(4, 5, 0), Point(4, 4, 0), Point(4, 3, 0), Point(4, 2, 1), Point(3, 2, 0), Point(3, 0, 0), Point(2, 0, 0), Point(1, 0, 0), Point(1, 1, 0), Point(2, 1, 0), Point(0, 5, 0), Point(1, 4, 0), Point(2, 2, 0), Point(3, 4, 0), Point(2, 5, 0), Point(2, 4, 0), Point(2, 3, 0), Point(1, 3, 0), Point(0, 2, 0), Point(0, 1, 0), Point(0, 0, 0)])
quad_mesh_maker = GhPythonScript(points=pt)  # -> out, new, mesh, a; inputs points: list of Point3d
# ---------- quad_mesh_maker: Python ----------
__author__ = "Karim"
__version__ = "2018.02.28"

import rhinoscriptsyntax as rs
import Rhino.Geometry as rg

points = sorted(points , key=lambda k: [k[0], k[1], k[2]])




x_values = [] 
y_values = [] 
z_values = []


for i in points:
    x = i[0]
    x_values.append(int(x))
    y = i[1]
    y_values.append(int(y))
    z = i[2]
    z_values.append(int(z))
    

min_x = sorted(x_values)[0]
max_x = sorted(x_values)[-1]
min_y = sorted(y_values)[0]
max_y = sorted(y_values)[-1]
min_z = sorted(z_values)[0]
max_z = sorted(z_values)[-1]

grid = [] 
new = []
projected_points = [] 
for pnt in points:
    x = int(pnt[0])
    y = int(pnt[1])
    z = 0
    new_point = (x,y,z)
    projected_points.append(new_point)

#print(projected_points)

for i in range(int(max_x + 1 - min_x)):
    for j in range(int(max_y + 1 - min_y)):
        #for k in range(int(max_z + 1)):
            pnt = (i + min_x,j + min_y,0)
            #grid.append(pnt)
            if pnt in projected_points:
                pass
            else:
                #print("im not there!")
                pnt = (i + min_x,j + min_y,0.1)
                projected_points.append(pnt)
#print(projected_points)

for i in range(len(points)):
    projected_points[i] = (points[i][0],points[i][1],points[i][2])

projected_point3d = []
for i in projected_points:
    projected_point3d.append(rg.Point3d(i[0], i[1], i[2]))
    
v = max_x - min_x + 1
u = max_y - min_y + 1
w = max_z - min_z + 1
print(len(projected_point3d))

projected_point3d = sorted(projected_point3d , key=lambda k: [k[0], k[1], k[2]])

#print(projected_point3d)
for i in range(len(projected_point3d)-1):
    zsum = 0
    n = 1
    if projected_point3d[i][2] == 0.1:
        if (i+1)/u-int((i+1)/u) != 0 and projected_point3d[i+1][2]!=0.1 :
            zsum += projected_point3d[i+1][2]
            n += 1
        if (i-1)/u-int((i-1)/u) != (u-1)/u  and projected_point3d[i-1][2]!=0.1:
            zsum += projected_point3d[i-1][2]
            n += 1
        if (i+u) < len(projected_point3d) and projected_point3d[i+u][2] != 0.1:
            zsum += projected_point3d[i+u][2]
            n += 1
        if (i-u) > 0 and projected_point3d[i-u][2] != 0.1 :
            zsum += projected_point3d[i-u][2]
            n += 1

        projected_point3d[i] = rg.Point3d(projected_point3d[i][0], projected_point3d[i][1], zsum/n)

Mesh = rg.Mesh()
for k in range (len(projected_point3d)):
    Mesh.Vertices.Add(projected_point3d[k])

for k in range(int((u-1)*(v-1))):
#for k in range(20):

    v0 = int(k/(u-1))
    n0 = int(v0 * u + k - v0 * (u-1))
    n1 = int(n0 + 1)
    n2 = int(n0 + 1 + u)
    n3 = int(n0 + u)
    Mesh.Faces.AddFace(n0,n1,n2,n3)
    #print(n0,n1,n2,n3)

mesh = Mesh
a = points
# ---------- end quad_mesh_maker ----------
panel = Panel(pointcloud)
pointcloudclass = PythonScript(RefPoint="1,1,50")  # -> out; inputs points: list of Point3d, RefPoint: Point3d
# ---------- pointcloudclass: Python ----------
__author__ = "Karim"
__version__ = "2018.03.05"

import rhinoscriptsyntax as rs
import Rhino.Geometry as rg
from rhinoscriptsyntax import scriptcontext as sc

class PointCloudPoint:
    All = dict()
    
    def __init__(self,x,y,z):
        self.x = x
        self.y = y
        self.z = z
        self.Point3d = rg.Point3d(x,y,z)
        self.All[(x,y,z)] = self # what does this actually do?
    
    def find_neighboursFDN(self, threshold):
        neighbours = [] 
        for point in self.All.values():
            #why use self.Point3d and then point.Point3d?
            if self.Point3d.DistanceTo(point.Point3d) <= threshold:
                neighbours.append(point.Point3d)
        return neighbours
            
    def find_normal(self, RefPoint, threshold):
        neighbours = self.find_neighboursFDN(threshold)
        
        #find plane based on points of neighbours
        #find normal based on plane
        plane = rg.Plane.FitPlaneToPoints(neighbours)[1]
        normal = plane.Normal
        
        #this is finding the sign of the normal 
        if (RefPoint - self.Point3d) * normal < 0:
            self.normal = -normal 
        else:
            self.normal = normal

for pt in points:
	PointCloudPoint(pt.X,pt.Y,pt.Z)

sc.sticky['PointCloudPoint'] = PointCloudPoint
sc.sticky['ReferencePoint'] = RefPoint
# ---------- end pointcloudclass ----------
mesh = Mesh(quad_mesh_maker.mesh)
normal_display = PythonScript(points=quad_mesh_maker.a, threshold=Slider(2.944, range=0..10))  # -> out, normals; inputs points: list of Point3d
# ---------- normal_display: Python ----------
__author__ = "Karim"
__version__ = "2018.03.05"

import rhinoscriptsyntax as rs
import Rhino.Geometry as rg
from rhinoscriptsyntax import scriptcontext as sc


PointCloudPoint = sc.sticky['PointCloudPoint']
RefPoint = sc.sticky['ReferencePoint']

normals = [] 

for pnt in points:
    x = pnt.X
    y = pnt.Y
    z = pnt.Z
    point = PointCloudPoint.All[(x,y,z)]
    point.find_normal(RefPoint, threshold)
    normals.append(point.normal)
# ---------- end normal_display ----------
vdis = VectorDisplay(Anchor=quad_mesh_maker.a, Vector=normal_display.normals)
panel_2 = Panel(normal_display.normals)
