# Grasshopper definition TopLayerFromCSV_1.gh (Grasshopper 1.0.4)

path = FilePath("C:\Users\Karim\Dropbox\02_TU_DELFT\Geo1004_TuDelft\Assignment2\topVoxels.csv")

number_slider = Slider(1, range=0..10)  # disabled
# inputs
pointcloud = Point()  # disabled

panel = Panel(path)
file = ReadFile(File=path, PerLineParse=True)
panel_2 = Panel(file)

pointconverter = PythonScript(pointCloud=pointcloud, resolution=number_slider)  # -> out, csv, PointHeights, point3dList, PointFrequency; inputs pointCloud: list of Point3d; disabled
# ---------- pointconverter: Python ----------
import Rhino.Geometry as rg
import math as math

half = resolution/2
voxelList = []

#ghPoints is list of original points
#input is list of 3D Rhino points
#output is list of triplets with X,Y,Z

ghPoints = [] 
for point in pointCloud:
    position = rg.Point3d(point[0],point[1],point[2])
    ghPoints.append(position)
originalPoints = ghPoints #just for distinction put it in a new variable
#print(originalPoints)

#input is list of 3D points
#output are centers of voxels

for i in pointCloud:
    x = int(i.X/resolution)
    y = int(i.Y/resolution)
    z = int(i.Z/resolution)
    centerOfVoxel = (x*resolution+half,y*resolution+half,z*resolution+half)
    voxelList.append(centerOfVoxel)
    
voxelPoints = voxelList



uniquePoints = set(voxelPoints)
#input is list of 3D points
#output is a list of 3D points???
rhinoPoints = [] 
for j in uniquePoints:
    point = rg.Point3d(j[0],j[1],j[2])
    rhinoPoints.append(point)
uniquePoints = rhinoPoints

PointHeights = [] 
for u in uniquePoints:
	PointHeights.append(u[2])
	


point3dList = [] 
for k in uniquePoints:
    point3d = rg.Point3d(k[0],k[1],k[2])
    point3dList.append(point3d)

#this checks how many repeat points we have after the 'resolution' operator
dictionary = {}
for each_value in voxelPoints:
    if each_value in dictionary:
        dictionary[each_value] += 1
    else:
        dictionary[each_value] = 1

dictlist=[]
for key, value in dictionary.iteritems():
    temp = list(key)
    temp.append(value)
    #temp = [key,value]
    dictlist.append(temp)

csv = []
for value in dictlist:
    proper_point = (value[0],value[1],value[2],value[3])
    csv.append(proper_point)
    
    





    
PointFrequency = [] 
#list of how many points sit on top of each other
#we would define this as a 'weight' meaning, in this location, how many points
#sit on top of each other 
for weight in dictlist:
    PointFrequency.append(weight[3])
# ---------- end pointconverter ----------
division = Division(A=number_slider, B=2)  # disabled
# pointToVoxel
positions_point3d = Point(pointconverter.point3dList)  # disabled
bnd = Bounds(Numbers=pointconverter.PointFrequency)  # disabled
dedomain = DeconstructDomain(Domain=bnd)  # -> Start, End; disabled
voxeldrawer = GhPythonScript(points=positions_point3d, l=division, w=division, h=division)  # -> out, boxes; inputs points: list of Point3d; disabled
# ---------- voxeldrawer: Python ----------
__author__ = "Karim"
__version__ = "2018.02.20"

import rhinoscriptsyntax as rs
import Rhino.Geometry as rg 

def pointToMeshBox(point,u,v,w):
    

    MeshBox = rg.Mesh()

    
    MeshBox.Vertices.Add(point + rg.Vector3d(-u,-v,-w))
    MeshBox.Vertices.Add(point + rg.Vector3d(u,-v,-w))
    MeshBox.Vertices.Add(point + rg.Vector3d(u,v,-w))
    MeshBox.Vertices.Add(point + rg.Vector3d(-u,v,-w))
    MeshBox.Vertices.Add(point + rg.Vector3d(-u,-v,w))
    MeshBox.Vertices.Add(point + rg.Vector3d(u,-v,w))
    MeshBox.Vertices.Add(point + rg.Vector3d(u,v,w))
    MeshBox.Vertices.Add(point + rg.Vector3d(-u,+v,+w))

    MeshBox.Faces.AddFace(0,3,2,1)
    MeshBox.Faces.AddFace(0,4,7,3)
    MeshBox.Faces.AddFace(0,1,5,4)
    MeshBox.Faces.AddFace(1,2,6,5)
    MeshBox.Faces.AddFace(2,3,7,6)
    MeshBox.Faces.AddFace(4,5,6,7)

    #print(point)
    return MeshBox

boxes = [] 
for i in points:
    box = pointToMeshBox(i,l,w,h)
    boxes.append(box)
# ---------- end voxeldrawer ----------

python = GhPythonScript(points=file)  # -> out, new, mesh, a; inputs points: list of Point3d
# ---------- python: Python ----------
__author__ = "Karim"
__version__ = "2018.02.28"

import rhinoscriptsyntax as rs
import Rhino.Geometry as rg

points = sorted(points , key=lambda k: [k[0], k[1], k[2]])




x_values = [] 
y_values = [] 
z_values = []


for i in points:
    x = i[0]
    x_values.append(int(x))
    y = i[1]
    y_values.append(int(y))
    z = i[2]
    z_values.append(int(z))
    

min_x = sorted(x_values)[0]
max_x = sorted(x_values)[-1]
min_y = sorted(y_values)[0]
max_y = sorted(y_values)[-1]
min_z = sorted(z_values)[0]
max_z = sorted(z_values)[-1]

grid = [] 
new = []
projected_points = [] 
for pnt in points:
    x = int(pnt[0])
    y = int(pnt[1])
    z = 0
    new_point = (x,y,z)
    projected_points.append(new_point)

#print(projected_points)

for i in range(int(max_x + 1 - min_x)):
    for j in range(int(max_y + 1 - min_y)):
        #for k in range(int(max_z + 1)):
            pnt = (i + min_x,j + min_y,0)
            #grid.append(pnt)
            if pnt in projected_points:
                pass
            else:
                #print("im not there!")
                pnt = (i + min_x,j + min_y,0.1)
                projected_points.append(pnt)
#print(projected_points)

for i in range(len(points)):
    projected_points[i] = (points[i][0],points[i][1],points[i][2])

projected_point3d = []
for i in projected_points:
    projected_point3d.append(rg.Point3d(i[0], i[1], i[2]))
    
v = max_x - min_x + 1
u = max_y - min_y + 1
w = max_z - min_z
print(len(projected_point3d))
projected_point3d = sorted(projected_point3d , key=lambda k: [k[0], k[1], k[2]])
#print(projected_point3d)
for i in range(len(projected_point3d)-1):
    zsum = 0
    n = 0
    if projected_point3d[i][2] == 0.1:
        if (i+1)/u-int((i+1)/u) != 0 and projected_point3d[i+1][2]!=0.1 :
            zsum += projected_point3d[i+1][2]
            n += 1
        if (i-1)/u-int((i-1)/u) != (u-1)/u  and projected_point3d[i-1][2]!=0.1:
            zsum += projected_point3d[i-1][2]
            n += 1
        if (i+u) < len(projected_point3d) and projected_point3d[i+u][2] != 0.1:
            zsum += projected_point3d[i+u][2]
            n += 1
        if (i-u) > 0 and projected_point3d[i-u][2] != 0.1 :
            zsum += projected_point3d[i-u][2]
            n += 1

        projected_point3d[i] = rg.Point3d(projected_point3d[i][0], projected_point3d[i][1], zsum/n)

Mesh = rg.Mesh()
for k in range (len(projected_point3d)):
    Mesh.Vertices.Add(projected_point3d[k])

for k in range(int((u-1)*(v-1))):
#for k in range(1):

    v0 = int(k/(u-1))
    n0 = int(v0 * u + k - v0 * (u-1))
    n1 = int(n0 + 1)
    n2 = int(n0 + 1 + u)
    n3 = int(n0 + u)
    Mesh.Faces.AddFace(n0,n1,n2,n3)
    #print(n0,n1,n2,n3)

mesh = Mesh
a = points
# ---------- end python ----------
panel_3 = Panel(python.mesh)
lng = ListLength(List=pointconverter.point3dList)  # disabled
bnd_2 = Bounds(Numbers=pointconverter.PointHeights)  # disabled
voxelcount = Panel(lng)  # disabled
dedomain_2 = DeconstructDomain(Domain=bnd_2)  # -> Start, End; disabled
# outputs
gradient = Gradient(
    LowerLimit=dedomain.Start,
    UpperLimit=dedomain.End,
    Parameter=pointconverter.PointFrequency,
    stops=[0: RGBA(102, 0, 255, 189), 1: RGBA(255, 0, 0, 198)])  # disabled
gradient_2 = Gradient(
    LowerLimit=dedomain.End,
    UpperLimit=dedomain.Start,
    Parameter=pointconverter.PointFrequency,
    stops=[0: RGB(234, 38, 0), 0.25: RGB(234, 126, 0), 0.5: RGB(254, 244, 84), 0.75: RGB(173, 203, 249), 1: RGB(75, 107, 169)])  # disabled

mesh = Mesh(voxeldrawer.boxes)  # disabled
preview = CustomPreview(Geometry=mesh, Material=gradient_2)  # disabled

preview_2 = CustomPreview(Geometry=mesh, Material=gradient)  # disabled
swatch = ColourSwatch(SwatchColor=RGBA(230, 0, 0, 186))  # disabled
preview_3 = CustomPreview(Geometry=mesh, Shader=swatch)  # disabled
