# Grasshopper definition VoxelizePointCloud_4.gh (Grasshopper 1.0.4)
# plug-ins: Python Interpreter

number_slider = Slider(1, range=0..10)
# inputs
pointcloud = Point([<point referenced from the Rhino model> x5000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])

pointconverter = PythonScript(pointCloud=pointcloud, resolution=number_slider)  # -> out, csv, PointHeights, point3dList, PointFrequency; inputs pointCloud: list of Point3d
# ---------- pointconverter: Python ----------
import Rhino.Geometry as rg
import math as math

half = resolution/2
voxelList = []

#ghPoints is list of original points
#input is list of 3D Rhino points
#output is list of triplets with X,Y,Z

ghPoints = [] 
for point in pointCloud:
    position = rg.Point3d(point[0],point[1],point[2])
    ghPoints.append(position)
originalPoints = ghPoints #just for distinction put it in a new variable
#print(originalPoints)

#input is list of 3D points
#output are centers of voxels

for i in pointCloud:
    x = int(i.X/resolution)
    y = int(i.Y/resolution)
    z = int(i.Z/resolution)
    centerOfVoxel = (x*resolution+half,y*resolution+half,z*resolution+half)
    voxelList.append(centerOfVoxel)
    
voxelPoints = voxelList



uniquePoints = set(voxelPoints)
#input is list of 3D points
#output is a list of 3D points???
rhinoPoints = [] 
for j in uniquePoints:
    point = rg.Point3d(j[0],j[1],j[2])
    rhinoPoints.append(point)
uniquePoints = rhinoPoints

PointHeights = [] 
for u in uniquePoints:
	PointHeights.append(u[2])
	


point3dList = [] 
for k in uniquePoints:
    point3d = rg.Point3d(k[0],k[1],k[2])
    point3dList.append(point3d)

#this checks how many repeat points we have after the 'resolution' operator
dictionary = {}
for each_value in voxelPoints:
    if each_value in dictionary:
        dictionary[each_value] += 1
    else:
        dictionary[each_value] = 1

dictlist=[]
for key, value in dictionary.iteritems():
    temp = list(key)
    temp.append(value)
    #temp = [key,value]
    dictlist.append(temp)

csv = []
for value in dictlist:
    proper_point = (value[0],value[1],value[2],value[3])
    csv.append(proper_point)
    
    





    
PointFrequency = [] 
#list of how many points sit on top of each other
#we would define this as a 'weight' meaning, in this location, how many points
#sit on top of each other 
for weight in dictlist:
    PointFrequency.append(weight[3])
# ---------- end pointconverter ----------
division = Division(A=number_slider, B=2)
# pointToVoxel
positions_point3d = Point(pointconverter.point3dList)
bnd = Bounds(Numbers=pointconverter.PointFrequency)
dedomain = DeconstructDomain(Domain=bnd)  # -> Start, End
voxeldrawer = GhPythonScript(points=positions_point3d, l=division, w=division, h=division)  # -> out, boxes; inputs points: list of Point3d
# ---------- voxeldrawer: Python ----------
__author__ = "Karim"
__version__ = "2018.02.20"

import rhinoscriptsyntax as rs
import Rhino.Geometry as rg 

def pointToMeshBox(point,u,v,w):
    

    MeshBox = rg.Mesh()

    
    MeshBox.Vertices.Add(point + rg.Vector3d(-u,-v,-w))
    MeshBox.Vertices.Add(point + rg.Vector3d(u,-v,-w))
    MeshBox.Vertices.Add(point + rg.Vector3d(u,v,-w))
    MeshBox.Vertices.Add(point + rg.Vector3d(-u,v,-w))
    MeshBox.Vertices.Add(point + rg.Vector3d(-u,-v,w))
    MeshBox.Vertices.Add(point + rg.Vector3d(u,-v,w))
    MeshBox.Vertices.Add(point + rg.Vector3d(u,v,w))
    MeshBox.Vertices.Add(point + rg.Vector3d(-u,+v,+w))

    MeshBox.Faces.AddFace(0,3,2,1)
    MeshBox.Faces.AddFace(0,4,7,3)
    MeshBox.Faces.AddFace(0,1,5,4)
    MeshBox.Faces.AddFace(1,2,6,5)
    MeshBox.Faces.AddFace(2,3,7,6)
    MeshBox.Faces.AddFace(4,5,6,7)

    #print(point)
    return MeshBox

boxes = [] 
for i in points:
    box = pointToMeshBox(i,l,w,h)
    boxes.append(box)
# ---------- end voxeldrawer ----------

lng = ListLength(List=pointconverter.point3dList)
bnd_2 = Bounds(Numbers=pointconverter.PointHeights)
voxelcount = Panel(lng)
dedomain_2 = DeconstructDomain(Domain=bnd_2)  # -> Start, End
# outputs
gradient = Gradient(
    LowerLimit=dedomain.Start,
    UpperLimit=dedomain.End,
    Parameter=pointconverter.PointFrequency,
    stops=[0: RGBA(102, 0, 255, 189), 1: RGBA(255, 0, 0, 198)])
gradient_2 = Gradient(
    LowerLimit=dedomain.End,
    UpperLimit=dedomain.Start,
    Parameter=pointconverter.PointFrequency,
    stops=[0: RGB(234, 38, 0), 0.25: RGB(234, 126, 0), 0.5: RGB(254, 244, 84), 0.75: RGB(173, 203, 249), 1: RGB(75, 107, 169)])

mesh = Mesh(voxeldrawer.boxes)
preview = CustomPreview(Geometry=mesh, Material=gradient_2)

preview_2 = CustomPreview(Geometry=mesh, Material=gradient)
preview_3 = CustomPreview(Geometry=mesh, Shader=ColourSwatch(SwatchColor=RGBA(230, 0, 0, 186)))
