# Grasshopper definition unnamedtest_01.gh (Grasshopper 1.0.4)

pt = Point([<point referenced from the Rhino model> x4610])
number_slider = Slider(0.162, range=0..1)
python = GhPythonScript(x=pt)  # -> out, a, bbox, xP; inputs x: list of Point3d
# ---------- python: Python ----------
__author__ = "Karim"

import rhinoscriptsyntax as rs
import Rhino.Geometry as rg

point_list = x 
all_points = [] 
for each_point in point_list:
    new_point = rs.coerce3dpoint(each_point)
    all_points.append(new_point)
    
a = all_points

#create a list of all the x values of the points and sort them
#find the min and max
#this will be your x_span for the bounding boz
#repeat for y and z

x_values = [] 
y_values = [] 
z_values = [] 

for i in all_points:
    x_values.append(i[0])
    y_values.append(i[1])
    z_values.append(i[2])

# max and min of x
max_x = max(x_values)
min_x = min(x_values)
# max and min of y 
max_y = max(y_values)
min_y = min(y_values)
# max and min of z
max_z = max(z_values)
min_z = min(z_values)

print("this is x max " + str(max_x))
print("this is x min " + str(min_x))
print("this is y max " + str(max_y))
print("this is y min " + str(min_y)) 
print("this is z max " + str(max_z))
print("this is z min " + str(min_z))

bbox = rg.BoundingBox(min_x, min_y, min_z, max_x, max_y, max_z)

x_span = int(round(max_x - min_x))
y_span = int(round(max_y - min_y))
z_span = int(round(max_z - min_z))

half = 0.5
point_grid = [] 
for i in range(x_span):
    for j in range(y_span):
        for k in range(z_span):

            point = rg.Point3d(half+i+min_x,j+half + min_y,k+half + min_z)
            point_grid.append(point)


xP = point_grid
# ---------- end python ----------
pt_2 = Point(python.xP)
box = CenterBox(Base=python.a, X=number_slider, Y=number_slider, Z=number_slider)
panel = Panel(python.xP)
panel_2 = Panel(python.a)
